# Grasshopper definition 3d-printed-structure.gh (Grasshopper 1.0.8)
# plug-ins: MeshEdit Components, treesloth01, Alpaca4d, VoxelPrint, NGon_RH8

brep = Brep(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)

# ---- group: increase me
steps = Slider(243, range=0..243)

# ----
voxelizer = BrepToVoxel(Brep=brep, VoxelSize="10", BeadWidth="30", LayerHeight="10")  # -> PointList, VoxelSettings
point = Point(voxelizer.PointList)
cullpt = CullDuplicates(Points=voxelizer.PointList, Tolerance=0.1, CullMode=1)  # -> Points, Indices, Valence
division = Division(A="1", B="10")
voxels = Voxels(Points=graft(cullpt.Points), Scale=division)  # -> Mesh, Points
one_over_x = OneOverX(Value="1000")
weldvertices = MeshWeldVertices(Mesh=voxels.Mesh, Tolerance=0.01)  # -> RuntimeMessage, Mesh
scale = Scale(Geometry=weldvertices.Mesh, Center=Point(0, 0, 0), Factor=one_over_x)  # -> Geometry, Transform
data = Data(simplify(scale.Geometry))
shift = ShiftPaths(Data=data, Offset=-1)  # -> flatten(Data)
partition = PartitionList(List=shift, Size="48")  # -> simplify(Chunks)
concat = Concatenate(FragmentA="{<", FragmentB=steps, FragmentC="}")
split = SplitTree(Data=simplify(partition), Masks=flatten(concat))  # -> Positive, Negative
geometry = Geometry(split.Positive)
demesh = DeconstructMesh(Mesh=flatten(split.Positive))  # -> flatten(Vertices), Faces, Colours, Normals
cull_duplicates = CullDuplicates(Points=demesh.Vertices, Tolerance="0.001", CullMode=3)  # -> Points, Indices, Valence
pt = Point(flatten(cull_duplicates.Points))
pdecon = Deconstruct(Point=pt)  # -> XComponent, YComponent, ZComponent
bnd = Bounds(Numbers=pdecon.ZComponent)
dedomain = DeconstructDomain(Domain=bnd)  # -> Start, End
addition = Addition(A="0.001", B=dedomain.Start)
smaller = SmallerThan(FirstNumber=pdecon.ZComponent, SecondNumber=addition)  # -> SmallerThan, OrEqualTo
weldvertices_2 = MeshWeldVertices(Mesh=split.Positive, Tolerance="0.001")  # -> RuntimeMessage, Mesh
dispatch = Dispatch(List=pt, DispatchPattern=smaller.SmallerThan)  # -> ListA, ListB
nd = ND(E=210000000, G=80760000, Ν=0.3, Rho=7850, mode="ElasticIsotropic (Alpaca4d)")
unit_x = UnitX(Factor=1)
pt_2 = Point(dispatch.ListB)
toggle = BooleanToggle(True)
Z = UnitZ(Factor="-0.1")
pt_3 = Point(dispatch.ListA)
constant_time_series = ConstantTimeSeriesAlpaca4d(LoadFactor=1)  # -> TimeSeries, Graph
point_load_alpaca4d = PointLoadAlpaca4d(Point=pt_2, Force=unit_x, Moment=Vector(0, 0, 0))
ssp_brick_alpaca4d = SSPBrickAlpaca4d(Mesh=weldvertices_2.Mesh, Material=nd, Colour=ColourSwatch(SwatchColor=RGB(191, 191, 191)))  # -> flatten(Element)
gravity_load_alpaca4d = GravityLoadAlpaca4d(Factor=1)
support = SupportAlpaca4d(Point=pt_3, Tx=toggle, Ty=toggle, Tz=toggle, Rx=True, Ry=True, RZ=True)
load_pattern_alpaca4d = LoadPatternAlpaca4d(TimeSeries=constant_time_series.TimeSeries, Loads=point_load_alpaca4d, Factor=1, mode="PlainPattern (Alpaca4d)")
assemblemodel_alpaca4d = AssembleModelAlpaca4d(Elements=ssp_brick_alpaca4d, Supports=support, LoadPatterns=load_pattern_alpaca4d, Tolerance="0.001")  # -> AlpacaModel, Mass
analysissettings = AnalysisSettingsAlpaca4d(AnalysisSteps="1")
ra = RunAnalysisAlpaca4d(AlpacaModel=assemblemodel_alpaca4d.AlpacaModel, Settings=analysissettings, settings=True)  # -> Log, AlpacaModel
panel = Panel(ra.Log)
view_results_wip_alpaca4d = ViewResults_WIPAlpaca4d(AlpacaModel=ra.AlpacaModel, Step=0)  # -> Info, Values, Colors; disabled
model_view_alpaca4d = ModelViewAlpaca4d(AlpacaModel=ra.AlpacaModel)  # -> AlpacaModel, Info; disabled
nd_2 = NodalDisplacementsAlpaca4d(AlpacaModel=ra.AlpacaModel, History=False, Step=0)  # -> Displacement, Rotation, port, Velocity, Acceleration, AngularVelocity, Acceleration_2, AngularAcceleration
vlen = VectorLength(Vector=nd_2.Displacement)
remap = RemapNumbers(Value=vlen, Source="2.5986e-6", Target=Domain(0, 1))  # -> Mapped, Clipped
